vi "Setup ADC Characterisation.gvi"   [LabVIEW NXG 5.0.0]
inputs:
  "Measure Driver": "Driver.gtype"  # Driver to obtain Id for.
  "Generate Driver": "Driver.gtype"
  "Start Volts": f32
  "Error in": error
  "Increment": f32
  "End Volts": f32
outputs:
  "ExecutableDirector": "ExecutableDirector.gtype"  # Configured Executable Director (execute once) capable of running the necessary commands.
  "MEAS Id": string  # The ID of the the *IDN? Executable which will be used to identify an incoming result.
  "Error Out": error
uses:
  Hardware Abstraction Framework::Common::WriteExecutable.gtype::Write Driver.gvi
  Hardware Abstraction Framework::Command::SCPI Acquire::Measure.gtype::Configure.gvi
  Hardware Abstraction Framework::Support::Helpers::Parameter Builder.gvi
  Hardware Abstraction Framework::Common::WriteExecutable.gtype::Write Parameters.gvi
  Hardware Abstraction Framework::Common::WriteExecutable.gtype::Read Id.gvi
  Hardware Abstraction Framework::Command::SCPI Generate::Voltage.gtype::Write Volts.gvi
  Hardware Abstraction Framework::Command::SCPI Generate::Voltage.gtype::Write Increment.gvi
  Hardware Abstraction Framework::Common::RepeatingDirector.gtype::Write Times Repeat.gvi
  Hardware Abstraction Framework::Common::ExecutableDirector.gtype::Write Wait Time.gvi
  Hardware Abstraction Framework::Common::ExecutableDirector.gtype::Add Executable.gvi
diagram:
  case ($"Error in") {
    frame Error, Default {
      w1 = $"Error in"
    }
    frame No Error {
      call "Write Driver.gvi"(Executable in="Measure.gtype" constant, Driver In=$"Measure Driver", Error in=$"Error in") -> (Executable out=w2, Error out=w3)
      call "Configure.gvi"(Measure in=w2, Function="DC Voltage", Buffer Name="mybuffer", Error in=w3) -> (Measure out=w4, Error out=w5)
      Build Array("READING", "TSTAMP") -> w6
      call "Parameter Builder.gvi"(Names=w6) -> (Parameters=w7)
      call "Write Parameters.gvi"(Executable in=w4, Parameters=w7, Error in=w5) -> (Executable out=w8, Error out=w9)
      call "Read Id.gvi"(Executable in=w8, Error in=w9) -> (Executable out=w10, Id=w11, Error out=w12)
      call "Write Volts.gvi"(Voltage in="Voltage.gtype" constant, Volts=$"Start Volts", Error in=$"Error in") -> (Voltage out=w13, Error out=w14)
      call "Write Increment.gvi"(Voltage in=w13, Increment=$Increment, Error in=w14) -> (Voltage out=w15, Error out=w16)
      call "Write Driver.gvi"(Executable in=w15, Driver In=$"Generate Driver", Error in=w16) -> (Executable out=w17, Error out=w18)
      # Calc stepping count
      Subtract(x=$"End Volts", y=$"Start Volts") -> w19
      Divide(x=w19, y=$Increment) -> w20
      Round Toward Positive Infinity(x=w20) -> w21
      call "Write Times Repeat.gvi"(RepeatingDirector in="RepeatingDirector.gtype" constant, Times Repeat=w21) -> (RepeatingDirector out=w22, Error out=w23)
      call "Write Wait Time.gvi"(ExecutableDirector in=w22, Wait Time=500, Error in=w23) -> (ExecutableDirector out=w24, Error out=w25)
      Merge Errors(w25, w18, w12) -> (error out=w26)
      call "Add Executable.gvi"(ExecutableDirector in=w24, Executable=w17, Error in=w26) -> (ExecutableDirector out=w27, Error out=w28)
      call "Add Executable.gvi"(ExecutableDirector in=w27, Executable=w10, Error in=w28) -> (ExecutableDirector out=w29, Error out=w1)
      $ExecutableDirector <- w29
      $"MEAS Id" <- w11
    }
  }
  $"Error Out" <- w1
